# Grasshopper definition C2_plane.gh (Grasshopper 0.9.76)

pi = Pi(Factor=Slider(0.407, range=0..2))
c_script = CSharpScript(theta=pi)  # -> out, A; inputs theta: Double
# ---------- c_script: C# ----------
    double[] temp = new double[9];
    temp[0] = Math.Cos(theta);
    temp[1] = -Math.Sin(theta);
    temp[2] = 0;
    temp[3] = Math.Sin(theta);
    temp[4] = Math.Cos(theta);
    temp[5] = 0;
    temp[6] = 0;
    temp[7] = 0;
    temp[8] = 1;
    A = temp;
# ---------- end c_script ----------
matrix = ConstructMatrix(Rows=3, Columns=3, Values=c_script.A)
matrix_2 = DisplayMatrix(matrix)

pi_2 = Pi(Factor=Slider(1.385, range=0..2))
c_script_2 = CSharpScript(theta=pi_2)  # -> out, A; inputs theta: Double
# ---------- c_script_2: C# ----------
    double[] temp = new double[9];
    temp[0] = 1;
    temp[1] = 0;
    temp[2] = 0;
    temp[3] = 0;
    temp[4] = Math.Cos(theta);
    temp[5] = -Math.Sin(theta);
    temp[6] = 0;
    temp[7] = Math.Sin(theta);
    temp[8] = Math.Cos(theta);
    A = temp;
# ---------- end c_script_2 ----------
matrix_3 = ConstructMatrix(Rows=3, Columns=3, Values=c_script_2.A)
matrix_4 = DisplayMatrix(matrix_3)

pt = ConstructPoint(XCoordinate="0", YCoordinate="10", ZCoordinate="10")
pt_2 = ConstructPoint(XCoordinate="0", YCoordinate="10", ZCoordinate="-10")
pt_3 = ConstructPoint(XCoordinate="0", YCoordinate="-10", ZCoordinate="-10")
pt_4 = ConstructPoint(XCoordinate="0", YCoordinate="-10", ZCoordinate="10")
srf4pt = _4PointSurface(CornerA=pt, CornerB=pt_2, CornerC=pt_3, CornerD=pt_4)

pi_3 = Pi(Factor=Slider(2, range=0..2))
c_script_3 = CSharpScript(theta=pi_3)  # -> out, A; inputs theta: Double
# ---------- c_script_3: C# ----------
    double[] temp = new double[9];
    temp[0] = Math.Cos(theta);
    temp[1] = 0;
    temp[2] = -Math.Sin(theta);
    temp[3] = 0;
    temp[4] = 1;
    temp[5] = 0;
    temp[6] = Math.Sin(theta);
    temp[7] = 0;
    temp[8] = Math.Cos(theta);
    A = temp;
# ---------- end c_script_3 ----------
matrix_5 = ConstructMatrix(Rows=3, Columns=3, Values=c_script_3.A)
matrix_6 = DisplayMatrix(matrix_5)

pt_5 = ConstructPoint(XCoordinate="10", YCoordinate="10", ZCoordinate="0")
pt_6 = ConstructPoint(XCoordinate="10", YCoordinate="-10", ZCoordinate="0")
pt_7 = ConstructPoint(XCoordinate="-10", YCoordinate="-10", ZCoordinate="0")
pt_8 = ConstructPoint(XCoordinate="-10", YCoordinate="10", ZCoordinate="0")
srf4pt_2 = _4PointSurface(CornerA=pt_5, CornerB=pt_6, CornerC=pt_7, CornerD=pt_8)

pt_9 = ConstructPoint(XCoordinate="0", YCoordinate="0", ZCoordinate="10")
pt_10 = ConstructPoint(XCoordinate="0", YCoordinate="0", ZCoordinate="-10")
ln = Line(StartPoint=pt_10, EndPoint=pt_9)

pt_11 = ConstructPoint(XCoordinate="10", YCoordinate="0", ZCoordinate="0")
pt_12 = ConstructPoint(XCoordinate="-10", YCoordinate="0", ZCoordinate="0")
ln_2 = Line(StartPoint=pt_12, EndPoint=pt_11)

xy = XYPlane(Origin=pt_9)
pipe = Pipe(Curve=ln, Radius=0.2, Caps=0)
cone = Cone(Base=xy, Radius=0.5, Length=2)  # -> Cone, Tip
mjoin = MeshJoin(Meshes=[pipe, cone.Cone])

yz = YZPlane(Origin=pt_11)
pipe_2 = Pipe(Curve=ln_2, Radius=0.2, Caps=0)
cone_2 = Cone(Base=yz, Radius=0.5, Length=2)  # -> Cone, Tip
mjoin_2 = MeshJoin(Meshes=[cone_2.Cone, pipe_2])

comp = Compound(Transforms=[matrix_3, matrix_5, matrix])

transform = Transform(Geometry=srf4pt_2, Transform=comp)
transform_2 = Transform(Geometry=srf4pt, Transform=comp)
preview = CustomPreview(Geometry=transform_2, Shader=ColourSwatch(SwatchColor=RGB(61, 117, 166)))
preview_2 = CustomPreview(Geometry=transform, Shader=ColourSwatch(SwatchColor=RGB(169, 181, 60)))

matrix_7 = DisplayMatrix(comp)
transform_3 = Transform(Geometry=mjoin, Transform=comp)
transform_4 = Transform(Geometry=mjoin_2, Transform=comp)
