# Grasshopper definition S2球极投影.gh (Grasshopper 0.9.76)

construct_point = ConstructPoint(XCoordinate=0, YCoordinate=0, ZCoordinate=1)
construct_point_2 = ConstructPoint(XCoordinate=0, YCoordinate=0, ZCoordinate=0)
number = Number("-10")
number_2 = Number("10")
file_path = FilePath("C:\Users\xyfx6\Desktop\1.png")
construct_point_3 = ConstructPoint(XCoordinate=number_2, YCoordinate=number, ZCoordinate=-1)
construct_point_4 = ConstructPoint(XCoordinate=number_2, YCoordinate=number_2, ZCoordinate=-1)
construct_point_5 = ConstructPoint(XCoordinate=number, YCoordinate=number, ZCoordinate=-1)
construct_point_6 = ConstructPoint(XCoordinate=number, YCoordinate=number_2, ZCoordinate=-1)
c_script = CSharpScript(filepath=file_path)  # -> out, Material, rect; inputs filepath: String
# ---------- c_script: C# ----------
    var RhMaterial = new Rhino.Display.DisplayMaterial();

    var WarpPic = new Bitmap(Bitmap.FromFile(filepath));


    RhMaterial.SetBitmapTexture(filepath, true);
    RhMaterial.Diffuse = Color.White;
    var GhMaterial = new Grasshopper.Kernel.Types.GH_Material();
    GhMaterial.Value = RhMaterial;

    var rec = new Rectangle3d(Plane.WorldXY, WarpPic.Width, WarpPic.Height);

    Material = GhMaterial;

    rect = rec;
# ---------- end c_script ----------
pi = Pi(Factor=Slider(2, range=0..2))
sphere = Sphere(Base=construct_point, Radius=0.1)
sphere_2 = Sphere(Base=construct_point_2, Radius=1)
number_slider = Slider(3.705, range=0..20)
cosine = Cosine(Value=pi)
sine = Sine(Value=pi)
_4point_surface = _4PointSurface(CornerA=construct_point_4, CornerB=construct_point_3, CornerC=construct_point_5, CornerD=construct_point_6)
custom_preview = CustomPreview(Geometry=sphere, Shader=ColourSwatch(SwatchColor=RGB(173, 17, 17)))
custom_preview_2 = CustomPreview(Geometry=sphere_2, Shader=ColourSwatch(SwatchColor=RGB(207, 224, 47)))
multiplication = Multiplication(A=sine, B=number_slider)
multiplication_2 = Multiplication(A=cosine, B=number_slider)
construct_point_7 = ConstructPoint(XCoordinate=multiplication_2, YCoordinate=multiplication, ZCoordinate=-1)
construct_point_8 = ConstructPoint(XCoordinate=0, YCoordinate=0, ZCoordinate=-1)
construct_point_9 = ConstructPoint(XCoordinate=0, YCoordinate=0, ZCoordinate=1)
custom_preview_3 = CustomPreview(Geometry=_4point_surface, Shader=ColourSwatch(SwatchColor=RGB(24, 42, 237)))
b = Number(multiplication)
a = Number(multiplication_2)
sphere_3 = Sphere(Base=construct_point_7, Radius=0.1)
line = Line(StartPoint=construct_point_8, EndPoint=construct_point_9)
c_script_2 = CSharpScript(a=a, b=b)  # -> out, x, y, z; inputs a: Double, b: Double
# ---------- c_script_2: C# ----------
    double t = 4.0 / (a * a + b * b + 4);
    x = t * a;
    y = t * b;
    z = 1 - 2 * t;
# ---------- end c_script_2 ----------
construct_point_10 = ConstructPoint(XCoordinate=c_script_2.x, YCoordinate=c_script_2.y, ZCoordinate=c_script_2.z)
c_script_3 = CSharpScript(start=construct_point, end=construct_point_7, t=Slider(1, range=0..1))  # -> out, endpt; inputs start: Point3d, end: Point3d, t: Double
# ---------- c_script_3: C# ----------
    Point3d temp = new Point3d();
    temp[0] = t * end[0] + (1.0 - t) * start[0];
    temp[1] = t * end[1] + (1.0 - t) * start[1];
    temp[2] = t * end[2] + (1.0 - t) * start[2];
    endpt = temp;
# ---------- end c_script_3 ----------
custom_preview_4 = CustomPreview(Geometry=sphere_3, Shader=ColourSwatch(SwatchColor=RGB(59, 133, 173)))
pipe = Pipe(Curve=line, Radius=0.1, Caps=0)
sphere_4 = Sphere(Base=construct_point_10, Radius=0.1)
line_2 = Line(StartPoint=construct_point, EndPoint=c_script_3.endpt)
custom_preview_5 = CustomPreview(Geometry=sphere_4, Shader=ColourSwatch(SwatchColor=RGB(33, 138, 77)))
pipe_2 = Pipe(Curve=line_2, Radius=0.02, Caps=0)
custom_preview_6 = CustomPreview(Geometry=pipe_2, Shader=ColourSwatch(SwatchColor=RGB(15, 10, 13)))
