# Grasshopper definition hopf1-1.gh (Grasshopper 0.9.76)
# plug-ins: HDTReference, Mesh Pipe

cluster = Cluster()

number = Number("-20")
number_2 = Number("20")
construct_point = ConstructPoint(XCoordinate=number, YCoordinate=number, ZCoordinate=-1)
construct_point_2 = ConstructPoint(XCoordinate=number_2, YCoordinate=number, ZCoordinate=-1)
construct_point_3 = ConstructPoint(XCoordinate=number, YCoordinate=number_2, ZCoordinate=-1)
construct_point_4 = ConstructPoint(XCoordinate=number_2, YCoordinate=number_2, ZCoordinate=-1)
colour_swatch = ColourSwatch(SwatchColor=RGB(132, 128, 255))
_4point_surface = _4PointSurface(CornerA=construct_point_4, CornerB=construct_point_2, CornerC=construct_point, CornerD=construct_point_3)
create_material = CreateMaterial(
    Diffuse=colour_swatch,
    Specular=ColourSwatch(SwatchColor=RGB(237, 191, 24)),
    Emission=colour_swatch,
    Transparency="0.4",
    Shine="0")
custom_preview = CustomPreview(Geometry=_4point_surface, Shader=create_material)

construct_point_5 = ConstructPoint(XCoordinate=0, YCoordinate=0, ZCoordinate=0)
sphere = Sphere(Base=construct_point_5, Radius="1")
custom_preview_2 = CustomPreview(Geometry=sphere, Shader=ColourSwatch(SwatchColor=RGB(247, 229, 25)))
custom_preview_materials = CustomPreviewMaterials(
    Geometry=sphere,
    DiffuseColor=RGB(255, 255, 255),
    Transparency=Slider(0, range=0..1),
    DiffuseBitmap="C:\Users\xyfx6\Desktop\68919931_p0_master1200.jpg")
number_slider = Slider(98, range=1..100)
construct_point_6 = ConstructPoint(XCoordinate=2, YCoordinate=Slider(6.84, range=0..10), ZCoordinate=Slider(2.95, range=0..10))
panel = Panel(number_slider)
multiplication = Multiplication(A=number_slider, B="2/100")
pi = Pi(Factor=multiplication)
sine = Sine(Value=pi)
cosine = Cosine(Value=pi)
integer_division = IntegerDivision(A=number_slider, B="5")

number_slider_2 = Slider(1, range=0..10)
series = Series(Start=0, Step="0.1", Count=integer_division)
panel_2 = Panel(series)
pi_2 = Pi(Factor=panel_2)
sine_2 = Sine(Value=pi_2)
cosine_2 = Cosine(Value=pi_2)
multiplication_2 = Multiplication(A=cosine_2, B=number_slider_2)
multiplication_3 = Multiplication(A=sine_2, B=number_slider_2)
a = Number(multiplication_3)
b = Number(multiplication_2)

number_3 = Number(number_slider_2)
multiplication_4 = Multiplication(A=cosine, B=number_3)
multiplication_5 = Multiplication(A=sine, B=number_3)
a_2 = Number(multiplication_5)
b_2 = Number(multiplication_4)

b_3 = Number(b_2)
a_3 = Number(a_2)

construct_point_7 = ConstructPoint(XCoordinate=a_3, YCoordinate=b_3, ZCoordinate=-1)

construct_point_8 = ConstructPoint(XCoordinate=0, YCoordinate=0, ZCoordinate=1)
sphere_2 = Sphere(Base=construct_point_8, Radius=0.1)
custom_preview_3 = CustomPreview(Geometry=sphere_2, Shader=ColourSwatch(SwatchColor=RGB(173, 17, 17)))
sphere_3 = Sphere(Base=construct_point_7, Radius=0.1)
c_script = CSharpScript(start=construct_point_8, end=construct_point_7, t=Slider(1, range=0..1))  # -> out, endpt; inputs start: Point3d, end: Point3d, t: Double
# ---------- c_script: C# ----------
    Point3d temp = new Point3d();
    temp[0] = t * end[0] + (1.0 - t) * start[0];
    temp[1] = t * end[1] + (1.0 - t) * start[1];
    temp[2] = t * end[2] + (1.0 - t) * start[2];
    endpt = temp;
# ---------- end c_script ----------
custom_preview_4 = CustomPreview(Geometry=sphere_3, Shader=ColourSwatch(SwatchColor=RGB(59, 133, 173)))

c_script_2 = CSharpScript(a=a_3, b=b_3)  # -> out, x, y, z; inputs a: Double, b: Double
# ---------- c_script_2: C# ----------
    double t = 4.0 / (a * a + b * b + 4);
    x = t * a;
    y = t * b;
    z = 1 - 2 * t;
# ---------- end c_script_2 ----------
construct_point_9 = ConstructPoint(XCoordinate=c_script_2.x, YCoordinate=c_script_2.y, ZCoordinate=c_script_2.z)
sphere_4 = Sphere(Base=construct_point_9, Radius=0.1)
custom_preview_5 = CustomPreview(Geometry=sphere_4, Shader=ColourSwatch(SwatchColor=RGB(33, 138, 77)))

line = Line(StartPoint=construct_point_8, EndPoint=c_script.endpt)
colour_swatch_2 = ColourSwatch(SwatchColor=RGB(15, 10, 13))
pipe = Pipe(Curve=line, Radius=0.02, Caps=0)

series_2 = Series(Start=0, Step="0.1", Count=Slider(20, range=0..20))
number_slider_3 = Slider(4, range=0..10)
panel_3 = Panel(series_2)
pi_3 = Pi(Factor=panel_3)
cosine_3 = Cosine(Value=pi_3)
sine_3 = Sine(Value=pi_3)
multiplication_6 = Multiplication(A=cosine_3, B=number_slider_3)
multiplication_7 = Multiplication(A=sine_3, B=number_slider_3)
a_4 = Number(multiplication_7)
b_4 = Number(multiplication_6)

series_3 = Series(Start=0, Step="0.1", Count=Slider(20, range=0..20))
panel_4 = Panel(series_3)
pi_4 = Pi(Factor=panel_4)
number_slider_4 = Slider(2, range=0..10)
cosine_4 = Cosine(Value=pi_4)
sine_4 = Sine(Value=pi_4)
multiplication_8 = Multiplication(A=cosine_4, B=number_slider_4)
multiplication_9 = Multiplication(A=sine_4, B=number_slider_4)
a_5 = Number(multiplication_9)
b_5 = Number(multiplication_8)

pi_5 = Pi(Factor="0")
圆上点的坐标 = CSharpScript(a=a, b=b, theta=pi_5)  # -> out, x, y, z, w; inputs a: Double, b: Double, theta: Double
# ---------- 圆上点的坐标: C# ----------
    double r = System.Math.Sqrt(1.0 / (1.0 + a * a + b * b));
    double x1 = r * System.Math.Cos(theta);
    double y1 = r * System.Math.Sin(theta);
    x = x1;
    y = y1;
    z = a * x1 - b * y1;
    w = a * y1 + b * x1;
# ---------- end 圆上点的坐标 ----------
球极投影_4 = CSharpScript(x=圆上点的坐标.x, y=圆上点的坐标.y, z=圆上点的坐标.z, w=圆上点的坐标.w)  # -> out, A, B, C; inputs x: Double, y: Double, z: Double, w: Double
# ---------- 球极投影_4: C# ----------
    //将单位球上的点(x,y,z,w)按球极投影到点(A,B,C,-1)
    //为了加速默认x,y,z,w平方和是1
    A = 2.0 * x / (1.0 - w);
    B = 2.0 * y / (1.0 - w);
    C = 2.0 * z / (1.0 - w);
# ---------- end 球极投影_4 ----------
construct_point_10 = ConstructPoint(XCoordinate=球极投影_4.A, YCoordinate=球极投影_4.B, ZCoordinate=球极投影_4.C)

pi_6 = Pi(Factor="0")
圆上点的坐标_2 = CSharpScript(a=a_5, b=b_5, theta=pi_6)  # -> out, x, y, z, w; inputs a: Double, b: Double, theta: Double; same code as 圆上点的坐标
球极投影_4_2 = CSharpScript(x=圆上点的坐标_2.x, y=圆上点的坐标_2.y, z=圆上点的坐标_2.z, w=圆上点的坐标_2.w)  # -> out, A, B, C; inputs x: Double, y: Double, z: Double, w: Double; same code as 球极投影_4
construct_point_11 = ConstructPoint(XCoordinate=球极投影_4_2.A, YCoordinate=球极投影_4_2.B, ZCoordinate=球极投影_4_2.C)

pi_7 = Pi(Factor="0")
圆上点的坐标_3 = CSharpScript(a=a_4, b=b_4, theta=pi_7)  # -> out, x, y, z, w; inputs a: Double, b: Double, theta: Double; same code as 圆上点的坐标
球极投影_4_3 = CSharpScript(x=圆上点的坐标_3.x, y=圆上点的坐标_3.y, z=圆上点的坐标_3.z, w=圆上点的坐标_3.w)  # -> out, A, B, C; inputs x: Double, y: Double, z: Double, w: Double; same code as 球极投影_4
construct_point_12 = ConstructPoint(XCoordinate=球极投影_4_3.A, YCoordinate=球极投影_4_3.B, ZCoordinate=球极投影_4_3.C)

pi_8 = Pi(Factor="2/3")

pi_9 = Pi(Factor="4/3")

pi_10 = Pi(Factor="2/3")

pi_11 = Pi(Factor="4/3")

圆上点的坐标_4 = CSharpScript(a=a, b=b, theta=pi_9)  # -> out, x, y, z, w; inputs a: Double, b: Double, theta: Double; same code as 圆上点的坐标
圆上点的坐标_5 = CSharpScript(a=a, b=b, theta=pi_8)  # -> out, x, y, z, w; inputs a: Double, b: Double, theta: Double; same code as 圆上点的坐标
colour_picker = ColourPicker(PickedColour=RGB(255, 0, 0))

球极投影_4_4 = CSharpScript(x=圆上点的坐标_4.x, y=圆上点的坐标_4.y, z=圆上点的坐标_4.z, w=圆上点的坐标_4.w)  # -> out, A, B, C; inputs x: Double, y: Double, z: Double, w: Double; same code as 球极投影_4
construct_point_13 = ConstructPoint(XCoordinate=球极投影_4_4.A, YCoordinate=球极投影_4_4.B, ZCoordinate=球极投影_4_4.C)

球极投影_4_5 = CSharpScript(x=圆上点的坐标_5.x, y=圆上点的坐标_5.y, z=圆上点的坐标_5.z, w=圆上点的坐标_5.w)  # -> out, A, B, C; inputs x: Double, y: Double, z: Double, w: Double; same code as 球极投影_4
construct_point_14 = ConstructPoint(XCoordinate=球极投影_4_5.A, YCoordinate=球极投影_4_5.B, ZCoordinate=球极投影_4_5.C)

pi_12 = Pi(Factor="2/3")

pi_13 = Pi(Factor="4/3")

圆上点的坐标_6 = CSharpScript(a=a_5, b=b_5, theta=pi_11)  # -> out, x, y, z, w; inputs a: Double, b: Double, theta: Double; same code as 圆上点的坐标
圆上点的坐标_7 = CSharpScript(a=a_5, b=b_5, theta=pi_10)  # -> out, x, y, z, w; inputs a: Double, b: Double, theta: Double; same code as 圆上点的坐标
colour_picker_2 = ColourPicker(PickedColour=RGB(10, 127, 245))

球极投影_4_6 = CSharpScript(x=圆上点的坐标_6.x, y=圆上点的坐标_6.y, z=圆上点的坐标_6.z, w=圆上点的坐标_6.w)  # -> out, A, B, C; inputs x: Double, y: Double, z: Double, w: Double; same code as 球极投影_4
construct_point_15 = ConstructPoint(XCoordinate=球极投影_4_6.A, YCoordinate=球极投影_4_6.B, ZCoordinate=球极投影_4_6.C)

球极投影_4_7 = CSharpScript(x=圆上点的坐标_7.x, y=圆上点的坐标_7.y, z=圆上点的坐标_7.z, w=圆上点的坐标_7.w)  # -> out, A, B, C; inputs x: Double, y: Double, z: Double, w: Double; same code as 球极投影_4
construct_point_16 = ConstructPoint(XCoordinate=球极投影_4_7.A, YCoordinate=球极投影_4_7.B, ZCoordinate=球极投影_4_7.C)

圆上点的坐标_8 = CSharpScript(a=a_4, b=b_4, theta=pi_13)  # -> out, x, y, z, w; inputs a: Double, b: Double, theta: Double; same code as 圆上点的坐标
圆上点的坐标_9 = CSharpScript(a=a_4, b=b_4, theta=pi_12)  # -> out, x, y, z, w; inputs a: Double, b: Double, theta: Double; same code as 圆上点的坐标
colour_picker_3 = ColourPicker(PickedColour=RGB(211, 255, 191))

球极投影_4_8 = CSharpScript(x=圆上点的坐标_8.x, y=圆上点的坐标_8.y, z=圆上点的坐标_8.z, w=圆上点的坐标_8.w)  # -> out, A, B, C; inputs x: Double, y: Double, z: Double, w: Double; same code as 球极投影_4
construct_point_17 = ConstructPoint(XCoordinate=球极投影_4_8.A, YCoordinate=球极投影_4_8.B, ZCoordinate=球极投影_4_8.C)

球极投影_4_9 = CSharpScript(x=圆上点的坐标_9.x, y=圆上点的坐标_9.y, z=圆上点的坐标_9.z, w=圆上点的坐标_9.w)  # -> out, A, B, C; inputs x: Double, y: Double, z: Double, w: Double; same code as 球极投影_4
construct_point_18 = ConstructPoint(XCoordinate=球极投影_4_9.A, YCoordinate=球极投影_4_9.B, ZCoordinate=球极投影_4_9.C)

circle_3pt = Circle3Pt(PointA=construct_point_10, PointB=construct_point_14, PointC=construct_point_13)  # -> Circle, Plane, Radius
mesh_pipe = MeshPipe(Curve=circle_3pt.Circle, Radius="0.04", Accuracy="0.01", Rotation=0, Segments=10, Caps=2)

scale = Scale(Geometry=mesh_pipe, Center=Point(0, 0, 0), Factor="0.3")  # -> Geometry, Transform
construct_point_19 = ConstructPoint(XCoordinate=Slider(6.45, range=0..10), YCoordinate=Slider(-7.813, range=-10..10), ZCoordinate=Slider(2.95, range=0..10))
pi_14 = Pi(Factor="0.5")
rotate_3d = Rotate3D(Geometry=scale.Geometry, Angle=pi_14, Center=Point(0, 0, 0), Axis=Vector(0, 1, 0))  # -> Geometry, Transform
move = Move(Geometry=rotate_3d.Geometry, Motion=construct_point_19)  # -> Geometry, Transform

custom_preview_6 = CustomPreview(Geometry=move.Geometry, Shader=colour_picker)

circle_3pt_2 = Circle3Pt(PointA=construct_point_11, PointB=construct_point_16, PointC=construct_point_15)  # -> Circle, Plane, Radius
mesh_pipe_2 = MeshPipe(Curve=circle_3pt_2.Circle, Radius="0.05", Accuracy="0.1", Rotation=0, Segments=10, Caps=2)

scale_2 = Scale(Geometry=mesh_pipe_2, Center=Point(0, 0, 0), Factor="0.3")  # -> Geometry, Transform
construct_point_20 = ConstructPoint(XCoordinate=Slider(6.45, range=0..10), YCoordinate=Slider(-7.813, range=-10..10), ZCoordinate=Slider(2.95, range=0..10))
pi_15 = Pi(Factor="0.5")
rotate_3d_2 = Rotate3D(Geometry=scale_2.Geometry, Angle=pi_15, Center=Point(0, 0, 0), Axis=Vector(0, 1, 0))  # -> Geometry, Transform
move_2 = Move(Geometry=rotate_3d_2.Geometry, Motion=construct_point_20)  # -> Geometry, Transform

custom_preview_7 = CustomPreview(Geometry=move_2.Geometry, Shader=colour_picker_2)

circle_3pt_3 = Circle3Pt(PointA=construct_point_12, PointB=construct_point_18, PointC=construct_point_17)  # -> Circle, Plane, Radius
mesh_pipe_3 = MeshPipe(Curve=circle_3pt_3.Circle, Radius="0.05", Accuracy="0.1", Rotation=0, Segments=10, Caps=2)

scale_3 = Scale(Geometry=mesh_pipe_3, Center=Point(0, 0, 0), Factor="0.3")  # -> Geometry, Transform
construct_point_21 = ConstructPoint(XCoordinate=Slider(6.45, range=0..10), YCoordinate=Slider(-7.813, range=-10..10), ZCoordinate=Slider(2.95, range=0..10))
pi_16 = Pi(Factor="0.5")
rotate_3d_3 = Rotate3D(Geometry=scale_3.Geometry, Angle=pi_16, Center=Point(0, 0, 0), Axis=Vector(0, 1, 0))  # -> Geometry, Transform
move_3 = Move(Geometry=rotate_3d_3.Geometry, Motion=construct_point_21)  # -> Geometry, Transform

custom_preview_8 = CustomPreview(Geometry=move_3.Geometry, Shader=colour_picker_3)

# ==== cluster Cluster
