# Grasshopper definition hopf2.gh (Grasshopper 0.9.76)

number_slider = Slider(0, range=0..40000)
mod = Modulus(A=number_slider, B="200")
integer_division = IntegerDivision(A=number_slider, B="200")

subtraction = Subtraction(A=mod, B="100")
subtraction_2 = Subtraction(A=integer_division, B="100")
multiplication = Multiplication(A=subtraction, B="0.1")
multiplication_2 = Multiplication(A=subtraction_2, B="0.1")
panel = Panel([multiplication_2, multiplication])

a = Number(multiplication)
b = Number(multiplication_2)

pi = Pi(Factor="0")
圆上点的坐标 = CSharpScript(a=a, b=b, theta=pi)  # -> out, x, y, z, w; inputs a: Double, b: Double, theta: Double
# ---------- 圆上点的坐标: C# ----------
    double r = System.Math.Sqrt(1.0 / (1.0 + a * a + b * b));
    double x1 = r * System.Math.Cos(theta);
    double y1 = r * System.Math.Sin(theta);
    x = x1;
    y = y1;
    z = a * x1 - b * y1;
    w = a * y1 + b * x1;
# ---------- end 圆上点的坐标 ----------
球极投影_4 = CSharpScript(x=圆上点的坐标.x, y=圆上点的坐标.y, z=圆上点的坐标.z, w=圆上点的坐标.w)  # -> out, A, B, C; inputs x: Double, y: Double, z: Double, w: Double
# ---------- 球极投影_4: C# ----------
    //将单位球上的点(x,y,z,w)按球极投影到点(A,B,C,-1)
    //为了加速默认x,y,z,w平方和是1
    A = 2.0 * x / (1.0 - w);
    B = 2.0 * y / (1.0 - w);
    C = 2.0 * z / (1.0 - w);
# ---------- end 球极投影_4 ----------
pt = ConstructPoint(XCoordinate=球极投影_4.A, YCoordinate=球极投影_4.B, ZCoordinate=球极投影_4.C)

pi_2 = Pi(Factor="2/3")

pi_3 = Pi(Factor="4/3")

圆上点的坐标_2 = CSharpScript(a=a, b=b, theta=pi_3)  # -> out, x, y, z, w; inputs a: Double, b: Double, theta: Double; same code as 圆上点的坐标
圆上点的坐标_3 = CSharpScript(a=a, b=b, theta=pi_2)  # -> out, x, y, z, w; inputs a: Double, b: Double, theta: Double; same code as 圆上点的坐标
colour = ColourPicker(PickedColour=RGB(107, 61, 77))

球极投影_4_2 = CSharpScript(x=圆上点的坐标_2.x, y=圆上点的坐标_2.y, z=圆上点的坐标_2.z, w=圆上点的坐标_2.w)  # -> out, A, B, C; inputs x: Double, y: Double, z: Double, w: Double; same code as 球极投影_4
pt_2 = ConstructPoint(XCoordinate=球极投影_4_2.A, YCoordinate=球极投影_4_2.B, ZCoordinate=球极投影_4_2.C)

球极投影_4_3 = CSharpScript(x=圆上点的坐标_3.x, y=圆上点的坐标_3.y, z=圆上点的坐标_3.z, w=圆上点的坐标_3.w)  # -> out, A, B, C; inputs x: Double, y: Double, z: Double, w: Double; same code as 球极投影_4
pt_3 = ConstructPoint(XCoordinate=球极投影_4_3.A, YCoordinate=球极投影_4_3.B, ZCoordinate=球极投影_4_3.C)

circle = Circle3Pt(PointA=pt, PointB=pt_3, PointC=pt_2)  # -> Circle, Plane, Radius
preview = CustomPreview(Geometry=circle.Circle, Shader=colour)
