# Grasshopper definition hopf_rotation.gh (Grasshopper 0.9.76)
# plug-ins: Mesh Pipe

number_slider = Slider(100, range=0..100)
series = Series(Start=0, Step="0.02", Count=number_slider)
number_slider_2 = Slider(8.286, range=0..10)
panel = Panel(series)
pi = Pi(Factor=panel)
series_2 = Series(Start=0, Step="0.02", Count=number_slider)
cos = Cosine(Value=pi)
sin = Sine(Value=pi)
multiplication = Multiplication(A=cos, B=number_slider_2)
multiplication_2 = Multiplication(A=sin, B=number_slider_2)
a = Number(multiplication_2)
b = Number(multiplication)

number_slider_3 = Slider(0.008, range=0..1)
multiplication_3 = Multiplication(A="1", B=number_slider_3)
multiplication_4 = Multiplication(A="4", B=number_slider_3)
pi_2 = Pi(Factor=multiplication_3)
pi_3 = Pi(Factor=multiplication_4)
num = Number(pi_2)
num_2 = Number(pi_3)
colour = ColourPicker(PickedColour=RGB(242, 31, 102))

pi_4 = Pi(Factor="0")
圆上点的坐标 = CSharpScript(a=a, b=b, theta=pi_4)  # -> out, x, y, z, w; inputs a: Double, b: Double, theta: Double
# ---------- 圆上点的坐标: C# ----------
    double r = System.Math.Sqrt(1.0 / (1.0 + a * a + b * b));
    double x1 = r * System.Math.Cos(theta);
    double y1 = r * System.Math.Sin(theta);
    x = x1;
    y = y1;
    z = a * x1 - b * y1;
    w = a * y1 + b * x1;
# ---------- end 圆上点的坐标 ----------

c_script = CSharpScript(x=圆上点的坐标.x, y=圆上点的坐标.y, z=圆上点的坐标.z, w=圆上点的坐标.w, theta1=num, theta2=num_2)  # -> out, A, B, C, D; inputs x: Double, y: Double, z: Double, w: Double, theta1: Double, theta2: Double
# ---------- c_script: C# ----------
    A = Math.Cos(theta1) * x - Math.Sin(theta1) * z;
    C = Math.Cos(theta1) * z + Math.Sin(theta1) * x;
    B = Math.Cos(theta2) * y - Math.Sin(theta2) * w;
    D = Math.Cos(theta2) * w + Math.Sin(theta2) * y;
# ---------- end c_script ----------

球极投影_4 = CSharpScript(x=c_script.A, y=c_script.B, z=c_script.C, w=c_script.D)  # -> out, A, B, C; inputs x: Double, y: Double, z: Double, w: Double
# ---------- 球极投影_4: C# ----------
    //将单位球上的点(x,y,z,w)按球极投影到点(A,B,C,-1)
    //为了加速默认x,y,z,w平方和是1
    A = 2.0 * x / (1.0 - w);
    B = 2.0 * y / (1.0 - w);
    C = 2.0 * z / (1.0 - w);
# ---------- end 球极投影_4 ----------
pt = ConstructPoint(XCoordinate=球极投影_4.A, YCoordinate=球极投影_4.B, ZCoordinate=球极投影_4.C)

pi_5 = Pi(Factor="2/3")

圆上点的坐标_2 = CSharpScript(a=a, b=b, theta=pi_5)  # -> out, x, y, z, w; inputs a: Double, b: Double, theta: Double; same code as 圆上点的坐标
c_script_2 = CSharpScript(x=圆上点的坐标_2.x, y=圆上点的坐标_2.y, z=圆上点的坐标_2.z, w=圆上点的坐标_2.w, theta1=num, theta2=num_2)  # -> out, A, B, C, D; inputs x: Double, y: Double, z: Double, w: Double, theta1: Double, theta2: Double; same code as c_script

球极投影_4_2 = CSharpScript(x=c_script_2.A, y=c_script_2.B, z=c_script_2.C, w=c_script_2.D)  # -> out, A, B, C; inputs x: Double, y: Double, z: Double, w: Double; same code as 球极投影_4
pt_2 = ConstructPoint(XCoordinate=球极投影_4_2.A, YCoordinate=球极投影_4_2.B, ZCoordinate=球极投影_4_2.C)

pi_6 = Pi(Factor="4/3")

圆上点的坐标_3 = CSharpScript(a=a, b=b, theta=pi_6)  # -> out, x, y, z, w; inputs a: Double, b: Double, theta: Double; same code as 圆上点的坐标
c_script_3 = CSharpScript(x=圆上点的坐标_3.x, y=圆上点的坐标_3.y, z=圆上点的坐标_3.z, w=圆上点的坐标_3.w, theta1=num, theta2=num_2)  # -> out, A, B, C, D; inputs x: Double, y: Double, z: Double, w: Double, theta1: Double, theta2: Double; same code as c_script

球极投影_4_3 = CSharpScript(x=c_script_3.A, y=c_script_3.B, z=c_script_3.C, w=c_script_3.D)  # -> out, A, B, C; inputs x: Double, y: Double, z: Double, w: Double; same code as 球极投影_4
pt_3 = ConstructPoint(XCoordinate=球极投影_4_3.A, YCoordinate=球极投影_4_3.B, ZCoordinate=球极投影_4_3.C)

circle = Circle3Pt(PointA=pt, PointB=pt_2, PointC=pt_3)  # -> Circle, Plane, Radius
mpipe = MeshPipe(Curve=circle.Circle, Radius="0.4", Accuracy="0.1", Rotation=0, Segments=10, Caps=2)
preview = CustomPreview(Geometry=mpipe, Shader=colour)
