# Grasshopper definition hopf1.gh (Grasshopper 0.9.76)
# plug-ins: Mesh Pipe

number_slider = Slider(20, range=0..20)
series = Series(Start=0, Step="0.1", Count=number_slider)
number_slider_2 = Slider(1.096, range=0..10)
panel = Panel(series)
pi = Pi(Factor=panel)
series_2 = Series(Start=0, Step="0.1", Count=number_slider)
cos = Cosine(Value=pi)
sin = Sine(Value=pi)
multiplication = Multiplication(A=cos, B=number_slider_2)
multiplication_2 = Multiplication(A=sin, B=number_slider_2)
a = Number(multiplication_2)
b = Number(multiplication)

number_slider_3 = Slider(40, range=0..40)
series_3 = Series(Start=0, Step="0.05", Count=number_slider_3)
number_slider_4 = Slider(3.615, range=0..10)
panel_2 = Panel(series_3)
pi_2 = Pi(Factor=panel_2)
series_4 = Series(Start=0, Step="0.05", Count=number_slider_3)
cos_2 = Cosine(Value=pi_2)
sin_2 = Sine(Value=pi_2)
multiplication_3 = Multiplication(A=cos_2, B=number_slider_4)
multiplication_4 = Multiplication(A=sin_2, B=number_slider_4)
a_2 = Number(multiplication_4)
b_2 = Number(multiplication_3)

number_slider_5 = Slider(20, range=0..20)
series_5 = Series(Start=0, Step="0.1", Count=number_slider_5)
number_slider_6 = Slider(2.396, range=0..10)
panel_3 = Panel(series_5)
pi_3 = Pi(Factor=panel_3)
series_6 = Series(Start=0, Step="0.1", Count=number_slider_5)
cos_3 = Cosine(Value=pi_3)
sin_3 = Sine(Value=pi_3)
multiplication_5 = Multiplication(A=cos_3, B=number_slider_6)
multiplication_6 = Multiplication(A=sin_3, B=number_slider_6)
a_3 = Number(multiplication_6)
b_3 = Number(multiplication_5)

pi_4 = Pi(Factor="0")
圆上点的坐标 = CSharpScript(a=a_2, b=b_2, theta=pi_4)  # -> out, x, y, z, w; inputs a: Double, b: Double, theta: Double
# ---------- 圆上点的坐标: C# ----------
    double r = System.Math.Sqrt(1.0 / (1.0 + a * a + b * b));
    double x1 = r * System.Math.Cos(theta);
    double y1 = r * System.Math.Sin(theta);
    x = x1;
    y = y1;
    z = a * x1 - b * y1;
    w = a * y1 + b * x1;
# ---------- end 圆上点的坐标 ----------
球极投影_4 = CSharpScript(x=圆上点的坐标.x, y=圆上点的坐标.y, z=圆上点的坐标.z, w=圆上点的坐标.w)  # -> out, A, B, C; inputs x: Double, y: Double, z: Double, w: Double
# ---------- 球极投影_4: C# ----------
    //将单位球上的点(x,y,z,w)按球极投影到点(A,B,C,-1)
    //为了加速默认x,y,z,w平方和是1
    A = 2.0 * x / (1.0 - w);
    B = 2.0 * y / (1.0 - w);
    C = 2.0 * z / (1.0 - w);
# ---------- end 球极投影_4 ----------
pt = ConstructPoint(XCoordinate=球极投影_4.A, YCoordinate=球极投影_4.B, ZCoordinate=球极投影_4.C)

pi_5 = Pi(Factor="0")
圆上点的坐标_2 = CSharpScript(a=a_3, b=b_3, theta=pi_5)  # -> out, x, y, z, w; inputs a: Double, b: Double, theta: Double; same code as 圆上点的坐标
球极投影_4_2 = CSharpScript(x=圆上点的坐标_2.x, y=圆上点的坐标_2.y, z=圆上点的坐标_2.z, w=圆上点的坐标_2.w)  # -> out, A, B, C; inputs x: Double, y: Double, z: Double, w: Double; same code as 球极投影_4
pt_2 = ConstructPoint(XCoordinate=球极投影_4_2.A, YCoordinate=球极投影_4_2.B, ZCoordinate=球极投影_4_2.C)

pi_6 = Pi(Factor="0")
圆上点的坐标_3 = CSharpScript(a=a, b=b, theta=pi_6)  # -> out, x, y, z, w; inputs a: Double, b: Double, theta: Double; same code as 圆上点的坐标
球极投影_4_3 = CSharpScript(x=圆上点的坐标_3.x, y=圆上点的坐标_3.y, z=圆上点的坐标_3.z, w=圆上点的坐标_3.w)  # -> out, A, B, C; inputs x: Double, y: Double, z: Double, w: Double; same code as 球极投影_4
pt_3 = ConstructPoint(XCoordinate=球极投影_4_3.A, YCoordinate=球极投影_4_3.B, ZCoordinate=球极投影_4_3.C)

pi_7 = Pi(Factor="2/3")

pi_8 = Pi(Factor="4/3")

pi_9 = Pi(Factor="2/3")

pi_10 = Pi(Factor="4/3")

pi_11 = Pi(Factor="2/3")

pi_12 = Pi(Factor="4/3")

圆上点的坐标_4 = CSharpScript(a=a_2, b=b_2, theta=pi_8)  # -> out, x, y, z, w; inputs a: Double, b: Double, theta: Double; same code as 圆上点的坐标
圆上点的坐标_5 = CSharpScript(a=a_2, b=b_2, theta=pi_7)  # -> out, x, y, z, w; inputs a: Double, b: Double, theta: Double; same code as 圆上点的坐标
colour = ColourPicker(PickedColour=RGB(29, 222, 122))

球极投影_4_4 = CSharpScript(x=圆上点的坐标_4.x, y=圆上点的坐标_4.y, z=圆上点的坐标_4.z, w=圆上点的坐标_4.w)  # -> out, A, B, C; inputs x: Double, y: Double, z: Double, w: Double; same code as 球极投影_4
pt_4 = ConstructPoint(XCoordinate=球极投影_4_4.A, YCoordinate=球极投影_4_4.B, ZCoordinate=球极投影_4_4.C)

球极投影_4_5 = CSharpScript(x=圆上点的坐标_5.x, y=圆上点的坐标_5.y, z=圆上点的坐标_5.z, w=圆上点的坐标_5.w)  # -> out, A, B, C; inputs x: Double, y: Double, z: Double, w: Double; same code as 球极投影_4
pt_5 = ConstructPoint(XCoordinate=球极投影_4_5.A, YCoordinate=球极投影_4_5.B, ZCoordinate=球极投影_4_5.C)

circle = Circle3Pt(PointA=pt, PointB=pt_5, PointC=pt_4)  # -> Circle, Plane, Radius
mpipe = MeshPipe(Curve=circle.Circle, Radius="0.1", Accuracy="0.1", Rotation=0, Segments=10, Caps=2)
preview = CustomPreview(Geometry=mpipe, Shader=colour)

圆上点的坐标_6 = CSharpScript(a=a_3, b=b_3, theta=pi_10)  # -> out, x, y, z, w; inputs a: Double, b: Double, theta: Double; same code as 圆上点的坐标
圆上点的坐标_7 = CSharpScript(a=a_3, b=b_3, theta=pi_9)  # -> out, x, y, z, w; inputs a: Double, b: Double, theta: Double; same code as 圆上点的坐标
colour_2 = ColourPicker(PickedColour=RGB(12, 131, 242))

球极投影_4_6 = CSharpScript(x=圆上点的坐标_6.x, y=圆上点的坐标_6.y, z=圆上点的坐标_6.z, w=圆上点的坐标_6.w)  # -> out, A, B, C; inputs x: Double, y: Double, z: Double, w: Double; same code as 球极投影_4
pt_6 = ConstructPoint(XCoordinate=球极投影_4_6.A, YCoordinate=球极投影_4_6.B, ZCoordinate=球极投影_4_6.C)

球极投影_4_7 = CSharpScript(x=圆上点的坐标_7.x, y=圆上点的坐标_7.y, z=圆上点的坐标_7.z, w=圆上点的坐标_7.w)  # -> out, A, B, C; inputs x: Double, y: Double, z: Double, w: Double; same code as 球极投影_4
pt_7 = ConstructPoint(XCoordinate=球极投影_4_7.A, YCoordinate=球极投影_4_7.B, ZCoordinate=球极投影_4_7.C)

circle_2 = Circle3Pt(PointA=pt_2, PointB=pt_7, PointC=pt_6)  # -> Circle, Plane, Radius
mpipe_2 = MeshPipe(Curve=circle_2.Circle, Radius="0.07", Accuracy="0.1", Rotation=0, Segments=10, Caps=2)
preview_2 = CustomPreview(Geometry=mpipe_2, Shader=colour_2)

圆上点的坐标_8 = CSharpScript(a=a, b=b, theta=pi_12)  # -> out, x, y, z, w; inputs a: Double, b: Double, theta: Double; same code as 圆上点的坐标
圆上点的坐标_9 = CSharpScript(a=a, b=b, theta=pi_11)  # -> out, x, y, z, w; inputs a: Double, b: Double, theta: Double; same code as 圆上点的坐标
colour_3 = ColourPicker(PickedColour=RGB(242, 31, 102))

球极投影_4_8 = CSharpScript(x=圆上点的坐标_8.x, y=圆上点的坐标_8.y, z=圆上点的坐标_8.z, w=圆上点的坐标_8.w)  # -> out, A, B, C; inputs x: Double, y: Double, z: Double, w: Double; same code as 球极投影_4
pt_8 = ConstructPoint(XCoordinate=球极投影_4_8.A, YCoordinate=球极投影_4_8.B, ZCoordinate=球极投影_4_8.C)

球极投影_4_9 = CSharpScript(x=圆上点的坐标_9.x, y=圆上点的坐标_9.y, z=圆上点的坐标_9.z, w=圆上点的坐标_9.w)  # -> out, A, B, C; inputs x: Double, y: Double, z: Double, w: Double; same code as 球极投影_4
pt_9 = ConstructPoint(XCoordinate=球极投影_4_9.A, YCoordinate=球极投影_4_9.B, ZCoordinate=球极投影_4_9.C)

circle_3 = Circle3Pt(PointA=pt_3, PointB=pt_9, PointC=pt_8)  # -> Circle, Plane, Radius
mpipe_3 = MeshPipe(Curve=circle_3.Circle, Radius="0.07", Accuracy="0.1", Rotation=0, Segments=10, Caps=2)
preview_3 = CustomPreview(Geometry=mpipe_3, Shader=colour_3)
