# Grasshopper definition one_point_rotation.gh (Grasshopper 0.9.76)

number_slider = Slider(0.25, range=0..2)
number_slider_2 = Slider(0.688, range=0..2)
pi = Pi(Factor=number_slider_2)
pi_2 = Pi(Factor=number_slider_2)
sin = Sine(Value=pi_2)
cos = Cosine(Value=pi_2)
sin_2 = Sine(Value=pi)
cos_2 = Cosine(Value=pi)
series = Series(Start=0, Step=0.05, Count=Slider(161, range=0..161))
panel = Panel(series)
multiplication = Multiplication(A="1", B=series)
multiplication_2 = Multiplication(A="1/4", B=series)
multiplication_3 = Multiplication(A=sin_2, B=sin)
multiplication_4 = Multiplication(A=cos_2, B=cos)
multiplication_5 = Multiplication(A=sin_2, B=cos)
multiplication_6 = Multiplication(A=cos_2, B=sin)
pi_3 = Pi(Factor=multiplication)
pi_4 = Pi(Factor=multiplication_2)
num = Number(pi_3)
num_2 = Number(pi_4)
c_script = CSharpScript(x="0.5", y="0.5", z="0.5", w="0.5", theta1=num, theta2=num_2)  # -> out, A, B, C, D; inputs x: Double, y: Double, z: Double, w: Double, theta1: Double, theta2: Double
# ---------- c_script: C# ----------
    A = Math.Cos(theta1) * x - Math.Sin(theta1) * y;
    B = Math.Cos(theta1) * y + Math.Sin(theta1) * x;
    C = Math.Cos(theta2) * z - Math.Sin(theta2) * w;
    D = Math.Cos(theta2) * w + Math.Sin(theta2) * z;
# ---------- end c_script ----------
球极投影_4 = CSharpScript(x=c_script.A, y=c_script.B, z=c_script.C, w=c_script.D)  # -> out, A, B, C; inputs x: Double, y: Double, z: Double, w: Double
# ---------- 球极投影_4: C# ----------
    //将单位球上的点(x,y,z,w)按球极投影到点(A,B,C,-1)
    //为了加速默认x,y,z,w平方和是1
    A = 2.0 * x / (1.0 - w);
    B = 2.0 * y / (1.0 - w);
    C = 2.0 * z / (1.0 - w);
# ---------- end 球极投影_4 ----------
pt = ConstructPoint(XCoordinate=球极投影_4.A, YCoordinate=球极投影_4.B, ZCoordinate=球极投影_4.C)
intcrv = Interpolate(Vertices=pt, Degree=3, Periodic=False, KnotStyle=1)  # -> Curve, Length, Domain
pipe = Pipe(Curve=intcrv.Curve, Radius="0.1", Caps=0)
preview = CustomPreview(Geometry=pipe, Shader=ColourSwatch(SwatchColor=RGB(204, 222, 40)))
