# Grasshopper definition 三个环.gh (Grasshopper 0.9.76)
# plug-ins: Mesh Pipe

cluster = Cluster()
cluster_2 = Cluster()
cluster_3 = Cluster()
number_slider = Slider(50, range=0..50)
pt = ConstructPoint(XCoordinate="10", YCoordinate="5", ZCoordinate="5")
multiplication = Multiplication(A=number_slider, B="0.15")
multiplication_2 = Multiplication(A=number_slider, B="0.35")
multiplication_3 = Multiplication(A=number_slider, B="0.25")
num = Number(multiplication)
num_2 = Number(multiplication_2)
num_3 = Number(multiplication_3)

pt_2 = ConstructPoint(XCoordinate=0, YCoordinate="-5", ZCoordinate=0)
pt_3 = ConstructPoint(XCoordinate=0, YCoordinate="5", ZCoordinate=0)
ln = Line(StartPoint=pt_2, EndPoint=pt_3)

pt_4 = ConstructPoint(XCoordinate="-5", YCoordinate=0, ZCoordinate=0)
pt_5 = ConstructPoint(XCoordinate="5", YCoordinate=0, ZCoordinate=0)
ln_2 = Line(StartPoint=pt_4, EndPoint=pt_5)

pt_6 = ConstructPoint(XCoordinate="-1", YCoordinate="-1", ZCoordinate=0)
pt_7 = ConstructPoint(XCoordinate="-1", YCoordinate="1", ZCoordinate=0)
pt_8 = ConstructPoint(XCoordinate="1", YCoordinate="1", ZCoordinate=0)
cir = Circle(Plane=pt_8, Radius=1)
cir_2 = Circle(Plane=pt_6, Radius=1)
cir_3 = Circle(Plane=pt_7, Radius=1)

pi = Pi(Factor=num_2)
cos = Cosine(Value=pi)
sin = Sine(Value=pi)
addition = Addition(A=cos, B="-1")
addition_2 = Addition(A=sin, B="-1")
a = Number(addition)
b = Number(addition_2)
colour = ColourPicker(PickedColour=RGB(55, 154, 230))

pt_9 = ConstructPoint(XCoordinate=a, YCoordinate=b, ZCoordinate=0)
sph = Sphere(Base=pt_9, Radius=0.1)

pi_2 = Pi(Factor="0")
圆上点的坐标 = CSharpScript(a=a, b=b, theta=pi_2)  # -> out, x, y, z, w; inputs a: Double, b: Double, theta: Double
# ---------- 圆上点的坐标: C# ----------
    double r = System.Math.Sqrt(1.0 / (1.0 + a * a + b * b));
    double x1 = r * System.Math.Cos(theta);
    double y1 = r * System.Math.Sin(theta);
    x = x1;
    y = y1;
    z = a * x1 - b * y1;
    w = a * y1 + b * x1;
# ---------- end 圆上点的坐标 ----------
球极投影_4 = CSharpScript(x=圆上点的坐标.x, y=圆上点的坐标.y, z=圆上点的坐标.z, w=圆上点的坐标.w)  # -> out, A, B, C; inputs x: Double, y: Double, z: Double, w: Double
# ---------- 球极投影_4: C# ----------
    //将单位球上的点(x,y,z,w)按球极投影到点(A,B,C,-1)
    //为了加速默认x,y,z,w平方和是1
    A = 2.0 * x / (1.0 - w);
    B = 2.0 * y / (1.0 - w);
    C = 2.0 * z / (1.0 - w);
# ---------- end 球极投影_4 ----------
pt_10 = ConstructPoint(XCoordinate=球极投影_4.A, YCoordinate=球极投影_4.B, ZCoordinate=球极投影_4.C)

pi_3 = Pi(Factor=num)
sin_2 = Sine(Value=pi_3)
cos_2 = Cosine(Value=pi_3)
addition_3 = Addition(A=cos_2, B="1")
addition_4 = Addition(A=sin_2, B="1")
a_2 = Number(addition_3)
b_2 = Number(addition_4)
colour_2 = ColourPicker(PickedColour=RGB(171, 41, 84))

pt_11 = ConstructPoint(XCoordinate=a_2, YCoordinate=b_2, ZCoordinate=0)
sph_2 = Sphere(Base=pt_11, Radius=0.1)

pi_4 = Pi(Factor="0")
圆上点的坐标_2 = CSharpScript(a=a_2, b=b_2, theta=pi_4)  # -> out, x, y, z, w; inputs a: Double, b: Double, theta: Double; same code as 圆上点的坐标
球极投影_4_2 = CSharpScript(x=圆上点的坐标_2.x, y=圆上点的坐标_2.y, z=圆上点的坐标_2.z, w=圆上点的坐标_2.w)  # -> out, A, B, C; inputs x: Double, y: Double, z: Double, w: Double; same code as 球极投影_4
pt_12 = ConstructPoint(XCoordinate=球极投影_4_2.A, YCoordinate=球极投影_4_2.B, ZCoordinate=球极投影_4_2.C)

pi_5 = Pi(Factor=num_3)
sin_3 = Sine(Value=pi_5)
cos_3 = Cosine(Value=pi_5)
addition_5 = Addition(A=cos_3, B="-1")
addition_6 = Addition(A=sin_3, B="1")
a_3 = Number(addition_5)
b_3 = Number(addition_6)
colour_3 = ColourPicker(PickedColour=RGB(31, 242, 102))

pt_13 = ConstructPoint(XCoordinate=a_3, YCoordinate=b_3, ZCoordinate=0)
sph_3 = Sphere(Base=pt_13, Radius=0.1)

pi_6 = Pi(Factor="0")
圆上点的坐标_3 = CSharpScript(a=a_3, b=b_3, theta=pi_6)  # -> out, x, y, z, w; inputs a: Double, b: Double, theta: Double; same code as 圆上点的坐标
球极投影_4_3 = CSharpScript(x=圆上点的坐标_3.x, y=圆上点的坐标_3.y, z=圆上点的坐标_3.z, w=圆上点的坐标_3.w)  # -> out, A, B, C; inputs x: Double, y: Double, z: Double, w: Double; same code as 球极投影_4
pt_14 = ConstructPoint(XCoordinate=球极投影_4_3.A, YCoordinate=球极投影_4_3.B, ZCoordinate=球极投影_4_3.C)

pi_7 = Pi(Factor="2/3")

pi_8 = Pi(Factor="4/3")

pi_9 = Pi(Factor="2/3")

pi_10 = Pi(Factor="4/3")

pi_11 = Pi(Factor="2/3")

pi_12 = Pi(Factor="4/3")

圆上点的坐标_4 = CSharpScript(a=a, b=b, theta=pi_8)  # -> out, x, y, z, w; inputs a: Double, b: Double, theta: Double; same code as 圆上点的坐标
圆上点的坐标_5 = CSharpScript(a=a, b=b, theta=pi_7)  # -> out, x, y, z, w; inputs a: Double, b: Double, theta: Double; same code as 圆上点的坐标

球极投影_4_4 = CSharpScript(x=圆上点的坐标_4.x, y=圆上点的坐标_4.y, z=圆上点的坐标_4.z, w=圆上点的坐标_4.w)  # -> out, A, B, C; inputs x: Double, y: Double, z: Double, w: Double; same code as 球极投影_4
pt_15 = ConstructPoint(XCoordinate=球极投影_4_4.A, YCoordinate=球极投影_4_4.B, ZCoordinate=球极投影_4_4.C)

球极投影_4_5 = CSharpScript(x=圆上点的坐标_5.x, y=圆上点的坐标_5.y, z=圆上点的坐标_5.z, w=圆上点的坐标_5.w)  # -> out, A, B, C; inputs x: Double, y: Double, z: Double, w: Double; same code as 球极投影_4
pt_16 = ConstructPoint(XCoordinate=球极投影_4_5.A, YCoordinate=球极投影_4_5.B, ZCoordinate=球极投影_4_5.C)

circle = Circle3Pt(PointA=pt_10, PointB=pt_16, PointC=pt_15)  # -> Circle, Plane, Radius
mpipe = MeshPipe(Curve=circle.Circle, Radius="0.1", Accuracy="0.1", Rotation=0, Segments=10, Caps=2)
move = Move(Geometry=mpipe, Motion=pt)  # -> Geometry, Transform
preview = CustomPreview(Geometry=[move.Geometry, sph], Shader=colour)

圆上点的坐标_6 = CSharpScript(a=a_2, b=b_2, theta=pi_10)  # -> out, x, y, z, w; inputs a: Double, b: Double, theta: Double; same code as 圆上点的坐标
圆上点的坐标_7 = CSharpScript(a=a_2, b=b_2, theta=pi_9)  # -> out, x, y, z, w; inputs a: Double, b: Double, theta: Double; same code as 圆上点的坐标

球极投影_4_6 = CSharpScript(x=圆上点的坐标_6.x, y=圆上点的坐标_6.y, z=圆上点的坐标_6.z, w=圆上点的坐标_6.w)  # -> out, A, B, C; inputs x: Double, y: Double, z: Double, w: Double; same code as 球极投影_4
pt_17 = ConstructPoint(XCoordinate=球极投影_4_6.A, YCoordinate=球极投影_4_6.B, ZCoordinate=球极投影_4_6.C)

球极投影_4_7 = CSharpScript(x=圆上点的坐标_7.x, y=圆上点的坐标_7.y, z=圆上点的坐标_7.z, w=圆上点的坐标_7.w)  # -> out, A, B, C; inputs x: Double, y: Double, z: Double, w: Double; same code as 球极投影_4
pt_18 = ConstructPoint(XCoordinate=球极投影_4_7.A, YCoordinate=球极投影_4_7.B, ZCoordinate=球极投影_4_7.C)

circle_2 = Circle3Pt(PointA=pt_12, PointB=pt_18, PointC=pt_17)  # -> Circle, Plane, Radius
mpipe_2 = MeshPipe(Curve=circle_2.Circle, Radius="0.1", Accuracy="0.1", Rotation=0, Segments=10, Caps=2)
move_2 = Move(Geometry=mpipe_2, Motion=pt)  # -> Geometry, Transform
preview_2 = CustomPreview(Geometry=[move_2.Geometry, sph_2], Shader=colour_2)

圆上点的坐标_8 = CSharpScript(a=a_3, b=b_3, theta=pi_12)  # -> out, x, y, z, w; inputs a: Double, b: Double, theta: Double; same code as 圆上点的坐标
圆上点的坐标_9 = CSharpScript(a=a_3, b=b_3, theta=pi_11)  # -> out, x, y, z, w; inputs a: Double, b: Double, theta: Double; same code as 圆上点的坐标

球极投影_4_8 = CSharpScript(x=圆上点的坐标_8.x, y=圆上点的坐标_8.y, z=圆上点的坐标_8.z, w=圆上点的坐标_8.w)  # -> out, A, B, C; inputs x: Double, y: Double, z: Double, w: Double; same code as 球极投影_4
pt_19 = ConstructPoint(XCoordinate=球极投影_4_8.A, YCoordinate=球极投影_4_8.B, ZCoordinate=球极投影_4_8.C)

球极投影_4_9 = CSharpScript(x=圆上点的坐标_9.x, y=圆上点的坐标_9.y, z=圆上点的坐标_9.z, w=圆上点的坐标_9.w)  # -> out, A, B, C; inputs x: Double, y: Double, z: Double, w: Double; same code as 球极投影_4
pt_20 = ConstructPoint(XCoordinate=球极投影_4_9.A, YCoordinate=球极投影_4_9.B, ZCoordinate=球极投影_4_9.C)

circle_3 = Circle3Pt(PointA=pt_14, PointB=pt_20, PointC=pt_19)  # -> Circle, Plane, Radius
mpipe_3 = MeshPipe(Curve=circle_3.Circle, Radius="0.1", Accuracy="0.1", Rotation=0, Segments=10, Caps=2)
move_3 = Move(Geometry=mpipe_3, Motion=pt)  # -> Geometry, Transform
preview_3 = CustomPreview(Geometry=[move_3.Geometry, sph_3], Shader=colour_3)

# ==== cluster Cluster
